# Grasshopper definition fabrication_control.ghx (Grasshopper 1.0.7)

bang = Button()
panel = Panel("Unload libraries")
unload = PythonScript(bang=bang)
# ---------- unload: Python ----------
from compas_rhino.utilities.misc import unload_modules

unload_modules("compas")
unload_modules("fabrication_control")
unload_modules("assembly_information_model")
# ---------- end unload ----------

reset_fabrication = Button()
tasks = GhPythonScript(create=Button())  # -> tasks
# ---------- tasks: Python ----------
import time
from fabrication_control.task import Task

class Task1(Task):
    def run(self, _stop_flag):
        # do something
        self.log("This is task 1")
        finished = True
        if finished:
            self.is_completed = True

class Task2(Task):
    def run(self, _stop_flag):
        # do something
        self.log("Task 2 counting up")
        for i in range(10):
            self.log("Counting: {}".format(i))
        finished = True
        if finished:
            self.is_completed = True

class Task3(Task):
    def run(self, _stop_flag):
        # do something
        self.log("Task 3 starting...")
        current_time = time.time()
        while time.time()<(current_time+1):
            self.log("waiting...")
        else:
            self.log("done waiting!")
        finished = True
        if finished:
            self.is_completed = True

if create:
    task1 = Task1()
    task1.parallelizable = True
    task2 = Task2()
    task2.parallelizable = True
    task3 = Task3()
    task3.parallelizable = True

tasks = [task1, task2, task3]
# ---------- end tasks ----------

# ----
# FABRICATION PROCESS CONTROL
init = Button()
start_fabrication = Button()
stop_fabrication = Button()
fabrication = PythonScript(init=init, parallelize=Toggle(False))  # -> out, fabrication
# ---------- fabrication: Python ----------
from scriptcontext import sticky as st
from fabrication_control.fabrication import Fabrication

if init:
    fabrication = Fabrication()
    fabrication.parallelize = parallelize
    st["fabrication"] = fabrication

fabrication = st["fabrication"]
# ---------- end fabrication ----------
set_tasks = Button()
set_fab_params = PythonScript(fabrication=fabrication.fabrication, tasks=tasks, set_tasks=set_tasks)  # -> out, fabrication; inputs tasks: list, set_tasks: Boolean
# ---------- set_fab_params: Python ----------
from scriptcontext import sticky as st

guid = str(ghenv.Component.InstanceGuid)
tasks_set_key = "tasks_set" + guid

if not tasks_set_key in st:
    st[tasks_set_key] = False

if set_tasks == True:
    print "setting tasks"    
    fabrication.clear_tasks()
    fabrication.set_tasks(tasks) #needs to be revised with aim
    st[tasks_set_key] = True
# ---------- end set_fab_params ----------
fabrication_2 = PythonScript(fabrication=set_fab_params.fabrication, start=start_fabrication, stop=stop_fabrication, reset=reset_fabrication)  # -> out
# ---------- fabrication_2: Python ----------
if start:
    #if robot.is_connected(): #and arduino.is_connected():
    print "starting process"
    fabrication.start()

if stop:
    print "stopping process"
    fabrication.stop()
    
if reset:
    print "resetting process"
    fabrication.reset()
# ---------- end fabrication_2 ----------

# ----
# STATE  VIEWER
trigger = Trigger(Interval=100, TimerInterval=100, Target=fabrication_state)
fabrication_state = PythonScript()  # -> out, state, num_tasks, num_current_task, num_tasks_left, log_messages
# ---------- fabrication_state: Python ----------
from scriptcontext import sticky as st

fabrication = st["fabrication"]

if hasattr(fabrication, "task_thread"):
    if fabrication.task_thread.is_alive():
        state = "THREAD RUNNING"
    else:
        state = "THREAD STOPPED"

num_tasks = len(fabrication.tasks)
if fabrication.current_task_key is not None:
    num_current_task = fabrication.current_task_key+1
else:
    num_current_task = 0
num_tasks_left = num_tasks-num_current_task
log_messages = fabrication.log_messages
# ---------- end fabrication_state ----------
state = Panel(fabrication_state.state)
num_tasks = Panel(fabrication_state.num_tasks)
num_current_task = Panel(fabrication_state.num_current_task)
log_messages = Panel(fabrication_state.log_messages)

num_tasks_left = Panel(fabrication_state.num_tasks_left)
