# Grasshopper definition fabrication_manager_py3.ghx (Grasshopper 1.0.8)

tasks = Python3Script(create=Button())  # -> tasks
# ---------- tasks: Python ----------
import time
from fabrication_manager.task import Task

class Task1(Task):
    def run(self, _stop_flag):
        # do something
        self.log("This is task 1")
        finished = True
        if finished:
            self.is_completed = True

class Task2(Task):
    def run(self, _stop_flag):
        # do something
        self.log("Task 2 counting up")
        for i in range(10):
            self.log("Counting: {}".format(i))
        finished = True
        if finished:
            self.is_completed = True

class Task3(Task):
    def run(self, _stop_flag):
        # do something
        self.log("Task 3 starting...")
        current_time = time.time()
        while time.time()<(current_time+1):
            self.log("waiting...")
        else:
            self.log("done waiting!")
        finished = True
        if finished:
            self.is_completed = True

if create:
    task1 = Task1()
    task1.parallelizable = True
    task2 = Task2()
    task2.parallelizable = True
    task3 = Task3()
    task3.parallelizable = True

tasks = [task1, task2, task3]

print(tasks)
# ---------- end tasks ----------

bang = Button()
panel = Panel("Unload libraries")
unload = Python3Script(bang=bang)
# ---------- unload: Python ----------
from compas_ghpython import unload_modules

unload_modules("compas")
unload_modules("fabrication_control")
unload_modules("assembly_information_model")
# ---------- end unload ----------

next_task = Button()

# ----
# FABRICATION PROCESS CONTROL
# 3>
start_fabrication = Button()
stop_fabrication = Button()
next_task_2 = Button()
set_tasks = Button()
init = Button()
fabricationmanager = Python3Script(
    tasks=tasks,
    init=init,
    parallelize=Toggle(True),
    set_tasks=set_tasks,
    start=start_fabrication,
    stop=stop_fabrication,
    reset=next_task,
    next_task=next_task_2,
    reset_task=tasks)  # -> out, server; inputs tasks: list, reset_task: list
# ---------- fabricationmanager: Python ----------
from scriptcontext import sticky as st
from fabrication_manager.fabrication import FabricationManager

print(tasks)

if init:
    fabrication = FabricationManager()
    fabrication.parallelize = parallelize
    st["fabrication"] = fabrication

fabrication = st["fabrication"]

if set_tasks:
    print("setting tasks")    
    fabrication.clear_tasks()
    fabrication.set_tasks(tasks)

if start:
    #if robot.is_connected(): #and arduino.is_connected():
    print("starting process")
    fabrication.start()

if stop:
    print("stopping process")
    fabrication.stop()
    
if reset:
    print("resetting process")
    fabrication.reset()

if next_task:
    t = fabrication.get_next_task()
    task_state_set(True, t)
    
if reset_task:
    t = fabrication.get_next_task()
    task_state_set(False, t)

if prev_task:
    t = fabrication.get_next_task()
    task_state_set(False, t)
    t = fabrication.tasks[fabrication.current_task_key-1]
    task_state_set(False, t)
    fabrication.get_next_task()

def task_state_set(state, t):
    t.is_completed = state
    t.is_running = False
# ---------- end fabricationmanager ----------

toggle = BooleanToggle(True)
fabrication_state = Python3Script()  # -> out, state, num_tasks, num_current_tasks, num_tasks_left, log_messages
# ---------- fabrication_state: Python ----------
from scriptcontext import sticky as st

fabrication = st["fabrication"]

if hasattr(fabrication, "task_thread"):
    if fabrication.task_thread.is_alive():
        state = "THREAD RUNNING"
    else:
        state = "THREAD STOPPED"

num_tasks = len(fabrication.tasks)
if fabrication.current_task_key is not None:
    num_current_task = fabrication.current_task_key+1
else:
    num_current_task = 0
num_tasks_left = num_tasks-num_current_task
log_messages = fabrication.log_messages
# ---------- end fabrication_state ----------

# ----
# STATE  VIEWER
trigger = Trigger(Interval=100, TimerInterval=100, Target=fabrication_state)
state = Panel(fabrication_state.state)
num_tasks = Panel(fabrication_state.num_tasks)
num_current_task = Panel(fabrication_state.num_current_tasks)

num_tasks_left = Panel(fabrication_state.num_tasks_left)
