# Grasshopper definition fabrication_manager_v2.ghx (Grasshopper 1.0.8)
# plug-ins: RhinoCodePluginGH

tasks = GhPythonScript(create=Button())  # -> tasks
# ---------- tasks: Python ----------
import time
from fabrication_manager.task import Task

class Task1(Task):
    def run(self, _stop_flag):
        # do something
        self.log("This is task 1")
        finished = True
        if finished:
            self.is_completed = True

class Task2(Task):
    def run(self, _stop_flag):
        # do something
        self.log("Task 2 counting up")
        for i in range(10):
            self.log("Counting: {}".format(i))
        finished = True
        if finished:
            self.is_completed = True

class Task3(Task):
    def run(self, _stop_flag):
        # do something
        self.log("Task 3 starting...")
        current_time = time.time()
        while time.time()<(current_time+1):
            self.log("waiting...")
        else:
            self.log("done waiting!")
        finished = True
        if finished:
            self.is_completed = True

if create:
    task1 = Task1()
    task1.parallelizable = True
    task2 = Task2()
    task2.parallelizable = True
    task3 = Task3()
    task3.parallelizable = True

tasks = [task1, task2, task3]
# ---------- end tasks ----------
button = Button()

reload = Button()
reload_2 = Python3Script(reload=reload)
# ---------- reload_2: Python ----------
if reload:
    from compas_rhino import unload_modules
    unload_modules("fabrication_manager")
    unload_modules('ur_fabrication_control')
# ---------- end reload_2 ----------

toggle = BooleanToggle(True)
py3 = Python3Script(create=Toggle(True))  # -> out, results, interrupt_event
# ---------- py3: Python ----------
from multiprocessing import Queue, Event

if create:
    results = Queue()
    interrupt_event = Event()
# ---------- end py3 ----------
tasks_2 = Python3Script(create=Toggle(True))  # -> out, tasks
# ---------- tasks_2: Python ----------
import time
from fabrication_manager.task import Task

class Task1(Task):
    def work_func(self, results, interrupt_event):
        # do something
        self.log("This is task 1")
        time.sleep(0.5)

class Task2(Task):
    def work_func(self, results, interrupt_event):
        # do something
        self.log("Task 2 counting up")
        for i in range(10):
            self.log("Counting: {}".format(i))
            time.sleep(0.1)

class Task3(Task):
    def work_func(self, results, interrupt_event):
        # do something
        self.log("Task 3 starting...")
        current_time = time.time()
        while time.time()<(current_time+1):
            self.log("waiting...")
        else:
            self.log("done waiting!")

if create:
    task1 = Task(key=0)
    task2 = Task(key=1)
    task3 = Task(key=2)

tasks = [task1, task2, task3]
# ---------- end tasks_2 ----------
next_task = Button()

# ----
# FABRICATION PROCESS CONTROL
# 3>
start_fabrication = Button()
stop_fabrication = Button()
next_task_2 = Button()
set_tasks = Button()
init = Button()
fabricationmanager = PythonScript(
    tasks=tasks,
    init=init,
    parallelize=Toggle(False),
    set_tasks=set_tasks,
    start=start_fabrication,
    stop=stop_fabrication,
    reset=next_task,
    next_task=next_task_2)  # -> out, server; inputs tasks: list
# ---------- fabricationmanager: Python ----------
from scriptcontext import sticky as st
from fabrication_manager.fabrication import FabricationManager

if init:
    fabrication = FabricationManager()
    fabrication.parallelize = parallelize
    st["fabrication"] = fabrication

fabrication = st["fabrication"]

if set_tasks:
    print "setting tasks"    
    fabrication.clear_tasks()
    fabrication.set_tasks(tasks)

if start:
    #if robot.is_connected(): #and arduino.is_connected():
    print "starting process"
    fabrication.start()

if stop:
    print "stopping process"
    fabrication.stop()
    
if reset:
    print "resetting process"
    fabrication.reset()

if next_task:
    t = fabrication.get_next_task()
    task_state_set(True, t)
    
if reset_task:
    t = fabrication.get_next_task()
    task_state_set(False, t)

if prev_task:
    t = fabrication.get_next_task()
    task_state_set(False, t)
    t = fabrication.tasks[fabrication.current_task_key-1]
    task_state_set(False, t)
    fabrication.get_next_task()

def task_state_set(state, t):
    t.is_completed = state
    t.is_running = False
# ---------- end fabricationmanager ----------

py3_2 = Python3Script(interrupt_event=py3.interrupt_event, set_flag=Toggle(True))  # -> out
# ---------- py3_2: Python ----------
if set_flag:
    interrupt_event.set()
else:
    interrupt_event.clear()

print(interrupt_event.is_set())
# ---------- end py3_2 ----------

# ----
# FABRICATION PROCESS CONTROL
set_tasks_2 = Button()
reset_fabrication = Button()
stop_fabrication_2 = Button()
skip_fabrication = Button()
start_fabrication_2 = Button()
init_2 = Button()

panel = Panel("192.168.52.1")
fabrication = Python3Script(init=init_2, tasks=tasks_2.tasks, set_tasks=set_tasks_2)  # -> out, fabrication; inputs tasks: list
# ---------- fabrication: Python ----------
from scriptcontext import sticky as st
from fabrication_manager import FabricationManager

server_ip = st["server_ip"]
server_port = st["server_port"]

if init:
    fabrication = FabricationManager((server_ip, server_port))
    st["fabrication"] = fabrication

fabrication = st["fabrication"]

if set_tasks:
    print("setting tasks")
    fabrication.clear_tasks()
    fabrication.set_tasks(tasks) #needs to be revised with aim
# ---------- end fabrication ----------
py3_3 = Python3Script(
    tasks=tasks_2.tasks,
    results=py3.results,
    interrupt_event=py3.interrupt_event,
    idx=Slider(0, range=0..100),
    run=Button(),
    wait=Toggle(True),
    update=Toggle(True))  # -> out, a; inputs tasks: list, idx: Int32
# ---------- py3_3: Python ----------
import time
import multiprocessing

multiprocessing.set_executable(r"C:\Users\gido\.rhinocode\py39-rh8\python.exe")

if run:
    task = tasks[idx]
    task.reset()
    task.start(results, interrupt_event)
    if wait:
        task.join()

if update:
    if tasks[idx].process is not None and not tasks[idx].process.is_alive():
        tasks[idx].join()
    for i in range(10):
        try:
            msg = results.get_nowait()
            print("LOG:", msg)
        except:
            pass
    print("Task {}: Running state={}".format(idx, tasks[idx].is_running))
    print("Task {}: Completion state={}".format(idx, tasks[idx].is_completed))

print(interrupt_event.is_set())
# print(tasks[idx].join())
# ---------- end py3_3 ----------
py3_4 = Python3Script(
    fabrication=fabrication.fabrication,
    start=start_fabrication_2,
    stop=stop_fabrication_2,
    skip=skip_fabrication,
    reset=reset_fabrication)  # -> out, a
# ---------- py3_4: Python ----------
if start:
    #if robot.is_connected(): #and arduino.is_connected():
    print("starting process")
    fabrication.start()
    
if skip:
    current_task = fabrication.get_next_task()
    current_task.is_completed = True

if stop:
    print("stopping process")
    fabrication.stop()
    
if reset:
    print("resetting process")
    fabrication.reset()
# ---------- end py3_4 ----------
py3_5 = Python3Script(start_server=Button())  # -> out, a
# ---------- py3_5: Python ----------
import os
import subprocess
import fabrication_manager

server = fabrication_manager.communication.async_server.__file__
# pc = os.path.dirname(__file__)
# pc = ghdoc.Path
# print(pc)
python = r"C:\Users\gido\.rhinocode\py39-rh8\python.exe"
# server = str(os.path.join(pc, "async_server.py"))
assert server
print(server)

def start_script():
    result = subprocess.Popen([python, server])
    print(result)

if start_server:
    start_script()
    # start_in_terminal()
# ---------- end py3_5 ----------
panel_2 = Panel(py3_3.out)

# ----
# STATE  VIEWER
trigger = Trigger(Interval=100, TimerInterval=100, Target=fabrication_state)
fabrication_state = PythonScript()  # -> out, state, num_tasks, num_current_task, num_tasks_left, log_messages
# ---------- fabrication_state: Python ----------
from scriptcontext import sticky as st

fabrication = st["fabrication"]

if hasattr(fabrication, "task_thread"):
    if fabrication.task_thread.is_alive():
        state = "THREAD RUNNING"
    else:
        state = "THREAD STOPPED"

num_tasks = len(fabrication.tasks)
if fabrication.current_task_key is not None:
    num_current_task = fabrication.current_task_key+1
else:
    num_current_task = 0
num_tasks_left = num_tasks-num_current_task
log_messages = fabrication.log_messages
# ---------- end fabrication_state ----------
state = Panel(fabrication_state.state)
num_tasks = Panel(fabrication_state.num_tasks)
num_current_task = Panel(fabrication_state.num_current_task)
log_messages = Panel(fabrication_state.log_messages)

# ----
# State viewer
trigger_2 = Trigger(Interval=1000, TimerInterval=1000, Target=py3_6)  # disabled
py3_6 = Python3Script()  # -> out, state, num_tasks, num_current_tasks, num_tasks_left, log_messages
# ---------- py3_6: Python ----------
from scriptcontext import sticky as st

fabrication = st["fabrication"]

if hasattr(fabrication, "task_thread"):
    if fabrication.task_thread.is_alive():
        state = "THREAD RUNNING"
    else:
        state = "THREAD STOPPED"
print(fabrication.current_task_key)
num_tasks = len(fabrication.tasks)
if fabrication.current_task_key is not None:
    num_current_task = fabrication.current_task_key-1
else:
    num_current_task = 0

num_tasks_left = num_tasks-num_current_task
log_messages = fabrication.log_messages

#assembly = st["assembly"]
# ---------- end py3_6 ----------
state_2 = Panel(py3_6.state)
num_tasks_2 = Panel(py3_6.num_tasks)
num_current_task_2 = Panel(py3_6.num_current_tasks)
num_tasks_left = Panel(py3_6.num_tasks_left)
log_messages_2 = Panel(py3_6.log_messages)

num_tasks_left_2 = Panel(fabrication_state.num_tasks_left)
